# Grasshopper definition materialに対応したやつ.gh (Grasshopper 1.0.7)
# plug-ins: Anemone, eleFront

crv = Curve(<curve referenced from the Rhino model>)
crv_2 = Curve(<curve referenced from the Rhino model>)
crv_3 = Curve(<curve referenced from the Rhino model>)
crv_4 = Curve(<curve referenced from the Rhino model>)
Z = UnitZ(Factor=Slider(28000, range=0..100000))
extr = Extrude(Base=crv_4, Direction=Z)
cap = CapHoles(Brep=extr)
bang = ExplodeTree(Data=cap)  # -> Branch0, Branch1, Branch2, Branch3; disabled
crv_5 = Curve(<curve referenced from the Rhino model>)
geo = Geometry([<curve referenced from the Rhino model> x20, <brep referenced from the Rhino model> x37])
geo_2 = Geometry([<curve referenced from the Rhino model> x11, <brep referenced from the Rhino model> x54])
crv_6 = Curve(<curve referenced from the Rhino model>)
geo_3 = Geometry([<curve referenced from the Rhino model> x9, <brep referenced from the Rhino model> x46])
geo_4 = Geometry([<curve referenced from the Rhino model> x11, <brep referenced from the Rhino model> x30])

# ----
# ユニット情報
number_slider = Slider(4000, range=0..10000)
crv_7 = Curve(<curve referenced from the Rhino model>)
crv_8 = Curve(<curve referenced from the Rhino model>)
panel = Panel("""Unit[9000×6000]
Unit[12000×6000]
Unit[6000×12000]
Unit[15000×6000]""")
panel_2 = Panel("""25
25
25
25""")
entwine = Entwine(Branch00=geo, Branch01=geo_3, Branch02=geo_4, Branch03=geo_2, FlattenInputs=True)
merge = Merge(Data1=crv_7, Data2=crv_8, Data3=crv_6, Data4=crv_5)

brep = Brep(cap)
mesh = Mesh(<mesh referenced from the Rhino model>)
brep_2 = Brep(<brep referenced from the Rhino model>)

# ----
# ボリュームはmeshで入力
jagged = SettingsSpeed()
brep_3 = Brep(cap)
mesh_2 = MeshBrep(Brep=brep_3, Settings=jagged)
tri = Triangulate(Mesh=mesh_2)  # -> Mesh, Count
mesh_3 = Mesh(tri.Mesh)

# ----
# 地形はmeshで入力
mesh_4 = Mesh(<mesh referenced from the Rhino model>)
tri_2 = Triangulate(Mesh=mesh_4)  # -> Mesh, Count

panel_3 = Panel("-1")
crv_9 = Curve(<curve referenced from the Rhino model>)
offset_l = OffsetCurveLoose(Curve=crv_9, Distance=Slider(8000, range=0..10000))
pt = Point(<point referenced from the Rhino model>)

# ----
# 勾配を色で表示
demesh = DeconstructMesh(Mesh=mesh)  # -> Vertices, Faces, Colours, Normals
Z_2 = UnitZ(Factor=1)
_5_to_10 = ColourSwatch(SwatchColor=RGB(0, 229, 255))
_10_to_15 = ColourSwatch(SwatchColor=RGB(115, 255, 0))
_15_to_20 = ColourSwatch(SwatchColor=RGB(255, 247, 0))
_20_to_25 = ColourSwatch(SwatchColor=RGB(230, 172, 0))
over25 = ColourSwatch(SwatchColor=RGB(199, 0, 0))
_0_to_5 = ColourSwatch(SwatchColor=RGB(0, 76, 255))
angle = Angle(VectorA=demesh.Normals, VectorB=Z_2)  # -> Angle, Reflex
merge_2 = Merge(Data1=_0_to_5, Data2=_5_to_10, Data3=_10_to_15, Data4=_15_to_20, Data5=_20_to_25, Data6=over25)
deg = Degrees(Radians=angle.Angle)
c_script = CSharpScript(angle=deg, col=merge_2)  # -> out, A; inputs angle: list of Double, col: list of Color
# ---------- c_script: C# usings ----------
using System.Drawing;
# ---------- c_script: C# ----------
    var colList = new List<Color>();

    foreach(var num in angle){
      if(num > 25){
        colList.Add(col[5]);
      }
      else if(num >= 20){
        colList.Add(col[4]);
      }
      else if(num >= 15){
        colList.Add(col[3]);
      }
      else if(num >= 10){
        colList.Add(col[2]);
      }
      else if(num >= 5){
        colList.Add(col[1]);
      }
      else if(num >= 0){
        colList.Add(col[0]);
      }
    }

    A = colList;
# ---------- end c_script ----------
conmesh = ConstructMesh(Vertices=demesh.Vertices, Faces=demesh.Faces, Colours=c_script.A)

loft = Loft(Curves=offset_l, Options={Adjust=False, Closed=False, LoftEnds=0, LoftSimp=0, LoftType=0, Rebuild=10, Refit=0.01})

# ----
# Contour
bbox = BoundingBox(Content=mesh, Plane=PlaneXY(0, 0, 0))  # -> Box, Box_2
debox = DeconstructBox(Box=bbox.Box)  # -> Plane, X, Y, Z
range = Range(Domain=debox.Z, Steps=Slider(128, range=10..500))
Z_3 = UnitZ(Factor=range)
xy = XYPlane(Origin=Z_3)
sec = MeshPlane(Mesh=mesh, Plane=xy)

# ----
# 一定勾配以下のfaceのみ表示
facen = FaceNormals(Mesh=mesh)  # -> Centers, Normals
Z_4 = UnitZ(Factor=1)
angle_2 = Angle(VectorA=facen.Normals, VectorB=Z_4)  # -> Angle, Reflex
deg_2 = Degrees(Radians=angle_2.Angle)
smaller = SmallerThan(FirstNumber=Slider(25, range=0..43), SecondNumber=deg_2)  # -> SmallerThan, OrEqualTo
cullf = CullFaces(Mesh=mesh, Pattern=smaller.OrEqualTo)

cluster = Cluster()
panel_4 = Panel("""True
False""")

Z_5 = UnitZ(Factor=1)
multiplication = Multiplication(A=Z_5, B="-1")
relay = Relay([multiplication, Z_5])

preview = CustomPreview(Geometry=cullf, Material=ColourSwatch(SwatchColor=RGB(40, 46, 120)))
preview_2 = CustomPreview(Geometry=sec, Material=ColourSwatch(SwatchColor=RGB(0, 0, 0)))
preview_3 = CustomPreview(
    Geometry=conmesh,
    Material={diffuse=RGB(221, 160, 221), emission=RGB(66, 48, 66), shine=0.5, specular=RGB(255, 255, 255), transparency=0})

# ----
# FLをボリュームから取得
mdif = MeshDifference(MeshesA=mesh_3, MeshesB=tri_2.Mesh)
bbox_2 = BoundingBox(Content=mdif, Plane=PlaneXY(0, 0, 0), UnionBox=True)  # -> Box, Box_2
debox_2 = DeconstructBox(Box=bbox_2.Box)  # -> Plane, X, Y, Z
dedomain = DeconstructDomain(Domain=debox_2.Z)  # -> Start, End
addition = Addition(A=Slider(1682, range=0..10000), B=dedomain.Start)
subtraction = Subtraction(A=dedomain.End, B=addition)
division = Division(A=subtraction, B=number_slider)
floor = Floor(n=division)  # -> floored; inputs n: list; same code as floor
series = Series(Start=addition, Step=number_slider, Count=floor)
Z_6 = UnitZ(Factor=series)
xy_2 = XYPlane(Origin=Z_6)
sec_2 = MeshPlane(Mesh=mdif, Plane=xy_2)  # -> simplify(Curves)
srf = Surface(reparameterize(sec_2))
evalsrf = EvaluateSurface(Surface=srf, Point="0.5,0,5")  # -> Point, Normal, UDirection, VDirection, Frame
devec = DeconstructVector(Vector=evalsrf.Normal)  # -> XComponent, YComponent, ZComponent
larger = LargerThan(FirstNumber=devec.ZComponent, SecondNumber="0")  # -> LargerThan, OrEqualTo
flip = FlipCurve(Curve=sec_2)  # -> Curve, Flag
weave = Weave(Pattern=larger.OrEqualTo, Stream0=flip.Curve, Stream1=sec_2, NullGaps=False)
flatten = FlattenTree(Tree=weave, Path="{0}")

# ----
# 住戸プランの情報を取得
bbox_3 = BoundingBox(Content=merge, Plane=PlaneXY(0, 0, 0))  # -> Box, Box_2
debox_3 = DeconstructBox(Box=bbox_3.Box)  # -> Plane, X, Y, Z
rectangle = Rectangle(Plane=PlaneXY(0, 0, 0), XSize=debox_3.X, YSize=debox_3.Y, Radius=0)  # -> Rectangle, Length
domainlength = DomainLength(l=debox_3.X)  # -> d, d_abs; inputs l: list
# ---------- domainlength: Python ----------
d = [ll.T1 - ll.T0 for ll in l]
d_abs = map(abs,d)
# ---------- end domainlength ----------
domainlength_2 = DomainLength(l=debox_3.Y)  # -> d, d_abs; inputs l: list; same code as domainlength
rectanglevertices = Rectangle_vertices(rec=rectangle.Rectangle)  # -> leftlower, rightlower, rightupper, leftupper; inputs rec: list
# ---------- rectanglevertices: Python ----------
def get_rectangle_leftlower(rectangles):
    pl = [r.Plane for r in rectangles]
    xl = list(r.X.T0 for r in rectangles)
    yl = list(r.Y.T0 for r in rectangles)
    xu = list(r.X.T1 for r in rectangles)
    yu = list(r.Y.T1 for r in rectangles)
    xd = tuple(p.XAxis for p in pl)
    yd = tuple(p.YAxis for p in pl)


    t1 = (i*j+k*l for i,j,k,l in zip(xl,xd,yl,yd))
    t2 = (i*j+k*l for i,j,k,l in zip(xu,xd,yl,yd))
    t3 = (i*j+k*l for i,j,k,l in zip(xu,xd,yu,yd))
    t4 = (i*j+k*l for i,j,k,l in zip(xl,xd,yu,yd))

    pl1 = list(map(lambda p:p.Clone(),pl))
    [p.Translate(v) for p,v in zip(pl1,t1)]
    pl2 = list(map(lambda p:p.Clone(),pl))
    [p.Translate(v) for p,v in zip(pl2,t2)]
    pl3 = tuple(map(lambda p:p.Clone(),pl))
    [p.Translate(v) for p,v in zip(pl3,t3)]
    [p.Translate(v) for p,v in zip(pl,t4)]
    pl4 = pl
    return pl1,pl2,pl3,pl4
    
leftlower,rightlower,rightupper,leftupper = get_rectangle_leftlower(rec)
# ---------- end rectanglevertices ----------
xy_3 = XYPlane(Origin=Point(0, 0, 0))
pi = Pi(Factor=1)
rotate = Rotate(Geometry=xy_3, Angle=pi, Plane=PlaneXY(0, 0, 0))  # -> Geometry, Transform
pt_2 = Point(rectanglevertices.leftlower)
move = Move(Geometry=rotate.Geometry, Motion=pt_2)  # -> Geometry, Transform

# ----
# 住戸の任意ジオメトリをグループ化
group = Group(Objects=entwine)  # -> flatten(Group)

cluster_2 = Cluster()
Z_7 = UnitZ(Factor=1)
roomunit_fes2024 = RoomUnitFES2024(w=domainlength.d, d=domainlength_2.d, origin=move.Geometry, name=panel, n=panel_2, geometries=group)  # -> RoomUnit; inputs origin: Plane, n: Int32
# ---------- roomunit_fes2024: Python ----------
from copy import deepcopy
import ghpythonlib.components as ghcomp
class Room:
    def __init__(self,unit_x,unit_y,origin,name,geometries):
        self.w = unit_x
        self.d = unit_y
        self.name = name
        self.origin = origin
        self.placed_plane = None
        self.geometries = geometries
        
    def __str__(self):
        if self.is_placed:
            return "Room:{} [placed]".format(self.name)
        else:
            return "Room:{}".format(self.name)
        
    def place(self,plane):
        
        self.placed_plane = plane
        
        
    def unplace(self):
        self.placed_plane = None
        
        
    @property
    def is_placed(self):
        return bool(self.placed_plane)
        
        
    def copy(self):
        new = Room(self.w,self.d,self.origin.Clone(),self.name,self.geometries)
        if self.is_placed:
            new.place(self.placed_plane)
        return new
        
if w and d and origin and name:
    ru = Room(w,d,origin,name,geometries)
    RoomUnit = [ru.copy() for _ in range(n)]
# ---------- end roomunit_fes2024 ----------

# ----
# 住戸情報をまとめて配置する順番に並び替える
flip_2 = FlipMatrix(Data=roomunit_fes2024)
flatten_2 = FlattenTree(Tree=roomunit_fes2024, Path="{0}")
flatten_3 = FlattenTree(Tree=flip_2, Path="{0}")

srf_2 = Surface(flatten)
jitter = Jitter(List=flatten_3, Jitter=1, Seed=Slider(69, range=0..100))  # -> Values, Indices
panel_5 = Panel(jitter.Values)
preview_4 = CustomPreview(Geometry=srf_2, Material=ColourSwatch(SwatchColor=RGBA(20, 255, 235, 73)))
md_slider = MDSlider(
    SliderMode=0,
    slider_value=Point(0.5090614877, 0.4033649724, 0.5),
    x_domain=Domain(-1, 1),
    y_domain=Domain(-1, 1),
    z_domain=Domain(0, 1))
python = GhPythonScript(x=md_slider)  # -> V; inputs x: Point3d
# ---------- python: Python ----------
from Rhino import Geometry as rg

if x:
    a = rg.Vector3d(x)
    if a.Length==0:
        a = rg.Vector3d.YAxis
    a.Unitize()
    
    V = a
# ---------- end python ----------
crv_10 = Curve(flatten)

# ----
# 配置
arrayroomunit_fes2024 = ArrayRoomUnitFES2024(plan_boundaries=crv_10, direction=python, rooms=jitter.Values, fix_order=Toggle(False))  # -> rooms; inputs plan_boundaries: list of Curve, direction: Vector3d, rooms: list
# ---------- arrayroomunit_fes2024: Python ----------
from Rhino import Geometry as rg
import ghpythonlib.components as ghcomp
from Rhino import RhinoDoc

TOL = RhinoDoc.ActiveDoc.ModelAbsoluteTolerance


if direction: direction.Unitize()
rooms = [r.copy() for r in rooms]

def get_plane_of_curve(curve):
    
    rst,plane = curve.TryGetPlane()
    if not rst:
        raise Exception("Can't get plane")
    else:
        return plane
        
def get_plane_to_array(curve,direction):
    plane_of_boundary = get_plane_of_curve(curve)
    yaxis_to_array = direction
    xaxis_to_array = rg.Vector3d.CrossProduct(yaxis_to_array,rg.Vector3d.ZAxis)
    xaxis_to_array.Unitize()
    plane_to_array = rg.Plane(plane_of_boundary.Origin,xaxis_to_array,yaxis_to_array)
    return plane_to_array
    
def get_bounding_rectangle(curve,plane):
    bb = curve.GetBoundingBox(plane)
    bbrect = rg.Rectangle3d(rg.Plane.WorldXY,bb.Min,bb.Max)
    tr = rg.Transform.ChangeBasis(plane,rg.Plane.WorldXY)
    bbrect.Transform(tr)
    return bbrect
    
def slice_rect_xdir(rect,start_distance,slice_length):
    assert start_distance>=0
    assert slice_length>=0
    lx,ux = rect.X.T0,rect.X.T1
    ly,uy = rect.Y.T0,rect.Y.T1
    stx = lx+start_distance
    enx = stx+slice_length
    if enx>=ux:
        print('over x limit')
        return None
    st_corner = rg.Point3d(rect.Plane.Origin + rect.Plane.XAxis*stx + rect.Plane.YAxis*uy)
    en_corner = rg.Point3d(rect.Plane.Origin + rect.Plane.XAxis*enx + rect.Plane.YAxis*ly)
    sliced_rect = rg.Rectangle3d(rect.Plane,st_corner,en_corner)
    return sliced_rect
    
    
def is_in_rect(pt,rect):
    xa,ya = rect.Plane.XAxis,rect.Plane.YAxis
    pt_local = pt - rect.Plane.Origin
    xlocal,ylocal = xa*pt_local,ya*pt_local
    
    rst = rect.X.IncludesParameter(xlocal) and rect.Y.IncludesParameter(ylocal)
    return rst
    
def is_rect_in_curve(rect,crv):
    rect_as_crv = rect.ToNurbsCurve()
    points = [rect_as_crv.PointAt(t) for t in rect_as_crv.DivideByCount(100,False)]
    points.extend(rect.Corner(i) for i in range(4))
    are_contains = (int(crv.Contains(pt,rect.Plane,TOL)) for pt in points)
    rst = all(are==1 or are==3 for are in are_contains)
    return rst
    
def sorted_curves_by_projected_y_value(curves,plane,from_larger=True):
    middles = [c.PointAtNormalizedLength(0.5) for c in curves]
    ys = [plane.YAxis * rg.Vector3d(p) for p in middles]
    sortedcrvs = [rst[1] for rst in sorted(zip(ys,curves),reverse=from_larger)]
    return sortedcrvs
    

def yaxissplit_rect_by_rects(original_rect,diff_rects):
    def union_if_overlapped(intervals):
        if len(intervals)<2:
            return intervals
        else:
            merged_indices = set()
            new_intervals = []
            for i in range(len(intervals)-1):
                if i in merged_indices: continue
                checking = intervals[i]
                others = intervals[i+1:]
                i_intersected = [j for j,o in enumerate(others) if checking.IncludesInterval(o)]
                if i_intersected:
                    i_intersected = [i+j+1 for j in i_intersected]
                    merged_indices |= set(i_intersected)
                    
                    merged = checking
                    for mi in merged_indices:
                        merged = rg.Interval.FromUnion(merged,intervals[mi])
                    new_intervals.append(merged)
                else:
                    new_intervals.append(checking)
            if len(intervals)-1 not in merged_indices:
                new_intervals.append(intervals[-1])
            return new_intervals
                    
    original_dom = original_rect.Y
    diffs_dom = union_if_overlapped([r.Y for r in diff_rects])
    
    all_values = [original_dom.Min]+[original_dom.Max]+[d.Min for d in diffs_dom]+[d.Max for d in diffs_dom]
    all_values.sort(reverse=True)
    
    y_intervals = [rg.Interval(s,e) for s,e in zip(all_values[:-1],all_values[1:])]
    rects = [rg.Rectangle3d(original_rect.Plane,original_rect.X,y) for y in y_intervals]
    return rects
    
    
def get_rect_in_curve_in_slice(curve,slice_rect):
    rst = rg.Intersect.Intersection.CurveCurve(curve,slice_rect.ToNurbsCurve(),TOL,TOL)
    params_intpt = [r.ParameterA for r in rst if r.IsPoint]
    if len(params_intpt)<2:
        curves = [curve]
    else:
        curves = curve.Split(params_intpt)
    middles = [c.PointAtNormalizedLength(0.5) for c in curves]
    isin = [is_in_rect(p,slice_rect) for p in middles]
    sliced_curves = rg.Curve.JoinCurves([c for c,iir in zip(curves,isin) if iir])
    slcrvs = sorted_curves_by_projected_y_value(sliced_curves,slice_rect.Plane)
    slrects = [get_bounding_rectangle(crv,slice_rect.Plane) for crv in slcrvs]

    splitted_rects = yaxissplit_rect_by_rects(slice_rect,slrects)
    rect_in_curves = [r for r in splitted_rects if is_rect_in_curve(r,curve)]
    if not rect_in_curves: return None
    rect = max(rect_in_curves,key=lambda r: r.Area)
    
    return rect
    
    
def place_room_to_rect(room,rect):
    if room.d<=abs(rect.Y.Length):
        plane = rg.Plane(rect.Corner(1),rect.Plane.XAxis,rect.Plane.YAxis)
        room.place(plane)
        return True
    else:
        return False

def get_room(rooms,except_room_name=[]):
    for r in rooms:
        not_placed = not r.is_placed
        not_except = r.name not in except_room_name
        if not_placed and not_except:
            return r
    else:
        return None

def array_to_curve(boundary,direction,rooms,fix_order):
    if all(r.is_placed for r in rooms): return
    plane_to_array = get_plane_to_array(boundary,direction)
    rect = get_bounding_rectangle(boundary,plane_to_array)
    starting_distance = 0
    placing_room = get_room(rooms)
    init_w = placing_room.w
    
    failured_room_type = []

        
    for _ in range(5000):
        if starting_distance>=abs(rect.X.Length) or placing_room is None: break
        placed = False
        slice_rect = slice_rect_xdir(rect,starting_distance,placing_room.w)
        if slice_rect:
            placing_rect = get_rect_in_curve_in_slice(boundary,slice_rect)
            if placing_rect:
                placed = place_room_to_rect(placing_room,placing_rect)
        
        if placed:
            failured_room_type = []
            starting_distance += placing_room.w
            placing_room = get_room(rooms)
        else:
            if fix_order:
                starting_distance += init_w
            else:
                failured_room_type.append(placing_room.name)
                placing_room = get_room(rooms,except_room_name=failured_room_type)
                if not placing_room: #all rooms type was tried to place
                    failured_room_type = []
                    placing_room = get_room(rooms)
                else:
                    starting_distance += init_w
    else:
        raise TimeOutError
    
    return rooms
    
    
def main():
    for b in plan_boundaries:
        rst = array_to_curve(b,direction,rooms,fix_order)
    else:
        rst = rooms
    return rst
    
    
rooms = main()
# ---------- end arrayroomunit_fes2024 ----------

# ----
# 配置チェック
exploderromunit_fes2024 = ExplodeRoomUnitFES2024(RoomUnit=arrayroomunit_fes2024)  # -> w, d, name, is_placed, geometries, graft(origin), graft(destination)
# ---------- exploderromunit_fes2024: Python ----------
from itertools import chain
w = RoomUnit.w
d = RoomUnit.d
origin = RoomUnit.origin
name = RoomUnit.name
if RoomUnit.is_placed:
    is_placed = True
    destination = RoomUnit.placed_plane
    geometries = RoomUnit.geometries
    #try:
    #    geometries = RoomUnit.geometries['geometry']
    #except:
    #    geometries = RoomUnit.geometries
else:
    is_placed = False
    destination = None
    geometries = None
# ---------- end exploderromunit_fes2024 ----------
orient = Orient(
    Geometry=exploderromunit_fes2024.geometries,
    Source=exploderromunit_fes2024.origin,
    Target=exploderromunit_fes2024.destination)  # -> Geometry, Transform
ma = MassAddition(Input=exploderromunit_fes2024.is_placed)  # -> Result, PartialResults

# ----
# Unitのindexを取得
cull = CullPattern(List=exploderromunit_fes2024.name, CullPattern=exploderromunit_fes2024.is_placed)
indexversatile = IndexVersatile(L=panel, v=cull)  # -> i; inputs L: list, v: list
# ---------- indexversatile: Python ----------
def find(ls,value):
    if value in ls:
        i = ls.index(value)
    else:
        i = -1
    return i

if L and v:
    i = [find(L,vv) for vv in v]
# ---------- end indexversatile ----------

# ----
# Rhinoで設定されたUintのMaterialを取得
rhatt = GetRhinoAttributes(Geometry=entwine, fullpath=False)  # -> Name, Layer, Color, MaterialName, SourceFile
tstat = TreeStatistics(Tree=entwine)  # -> Paths, Length, Count
item = ListItem(List=tstat.Paths, Index=indexversatile, Wrap=True)
branch = TreeBranch(Tree=rhatt.MaterialName, Path=item, MaintainPaths=False)

置かれた住戸の数 = Panel(ma.Result)
preview_5 = CustomPreview(Geometry=orient.Geometry, Material=ColourSwatch(SwatchColor=RGB(168, 168, 168)))

branch_2 = TreeBranch(Tree=rhatt.Color, Path=item, MaintainPaths=False)

# ----
# おかれていないBranchを削除
clean = CleanTree(RemoveNulls=True, RemoveInvalid=True, RemoveEmpty=invert(False), Tree=orient.Geometry)

# ----
# Materialを割り当て
ef_att = EleFrontAttributes(ColourSource="Object", ObjectColour=branch_2, MaterialName=branch)  # -> Attributes, Keys, Values, Name, Layer, ColourSource, DisplayColour, MaterialSource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

match = MatchTree(Tree=clean, Guide=ef_att.Attributes)
bake = BakeObjects(Geometry=match, Attributes=ef_att.Attributes, Bake=False, createGroups=True, ValueTable_createGroups=False)  # -> Message, Guids

探索最小半径 = Slider(1000, range=0..1000)
number_slider_2 = Slider(30, range=0..30)
移動距離 = Slider(1000, range=0..5000)
探索の候補の数 = Slider(24, range=0..64)
number_slider_3 = Slider(0, range=0..10)

series_2 = Series(Start=探索最小半径, Step=Slider(1000, range=0..2000), Count=Slider(5, range=0..100))
cluster_3 = Cluster_2(relay_2=mesh, P=pt, N=探索の候補の数, A=移動距離, R=series_2, low=number_slider_3, high=number_slider_2)
loop_start = LoopStart(N=Slider(0, range=0..1000), T=Button(), D0=mesh, D1=pt, D2=cluster_3, D3=graft(panel_4))  # -> port, Counter, Data, Data_2, Data_3, Data_4
subtraction_2 = Subtraction(A=series_2, B=Slider(0, range=0..1000))
meshray = MeshRay(Mesh=loop_start.Data, Point=loop_start.Data_2, Direction=relay)  # -> Point, Hit
meshray_2 = MeshRay(Mesh=loop_start.Data, Point=loop_start.Data_3, Direction=relay)  # -> Point, Hit
clean_2 = CleanTree(RemoveNulls=True, RemoveInvalid=True, RemoveEmpty=False, Tree=meshray.Point)
clean_3 = CleanTree(RemoveNulls=True, RemoveInvalid=True, RemoveEmpty=False, Tree=meshray_2.Point)  # -> flatten(Tree)
cir = Circle(Plane=clean_3, Radius=series_2)
divide = DivideCurve(Curve=cir, Count=探索の候補の数, Kinks=False)  # -> Points, Tangents, Parameters
panel_6 = Panel(loop_start.Data_4)
dist = Distance(PointA=clean_2, PointB=divide.Points)  # -> simplify(Distance)
larger_2 = LargerThan(FirstNumber=dist, SecondNumber=graft(subtraction_2))  # -> LargerThan, OrEqualTo
flatten_4 = FlattenTree(Tree=divide.Points, Path="{1}")
cull_2 = CullPattern(List=divide.Points, CullPattern=larger_2.OrEqualTo)  # -> flatten(List)
flatten_5 = FlattenTree(Tree=cull_2, Path="{0}")
merge_3 = Merge(Data1=flatten_4, Data2=flatten_5)
cull_3 = CullPattern(List=merge_3, CullPattern=panel_6)  # -> flatten(List)
meshray_3 = MeshRay(Mesh=loop_start.Data, Point=cull_3, Direction=relay)  # -> Point, Hit
clean_4 = CleanTree(RemoveNulls=True, RemoveInvalid=True, RemoveEmpty=False, Tree=meshray_3.Point)  # -> flatten(Tree)
vec2pt = Vector2Pt(PointA=clean_3, PointB=clean_4, Unitize=False)  # -> Vector, Length
angle_3 = Angle(VectorA=vec2pt.Vector, VectorB=Z_7)  # -> Angle, Reflex
deg_3 = Degrees(Radians=angle_3.Angle)  # -> flatten(Degrees)
subtraction_3 = Subtraction(A="90", B=deg_3)
python_2 = GhPythonScript(x=subtraction_3, low=number_slider_3, high=number_slider_2)  # -> a, simplify(graft(b)); inputs x: list
# ---------- python_2: Python ----------
import math
lst = x
n_lst = []
b = [True,False]


max_value = max(lst)
a = lst.index(max_value)
# ---------- end python_2 ----------
python_3 = GhPythonScript(x=subtraction_3, low=number_slider_3, high=number_slider_2)  # -> a, simplify(graft(b)); inputs x: list
# ---------- python_3: Python ----------
import math
lst = x
n_lst = []
b = [True,False]

for n in lst:
    if n >= low and n <= high:
        n_lst.append(n)
if len(n_lst) == 0:
    b = [False,True]
else:
    max_value = max(n_lst)
    a = lst.index(max_value)
# ---------- end python_3 ----------
item_2 = ListItem(List=vec2pt.Vector, Index=python_3.a, Wrap=True)
amp = Amplitude(Vector=item_2, Amplitude=移動距離)
merge_4 = Merge(Data1=loop_start.Data_3, Data2=loop_start.Data_2)  # -> simplify(graft(Result))
move_2 = Move(Geometry=clean_3, Motion=amp)  # -> Geometry, Transform
panel_7 = Panel(python_3.b)
merge_5 = Merge(Data1=move_2.Geometry, Data2=loop_start.Data_3)  # -> simplify(graft(Result))
cull_4 = CullPattern(List=merge_4, CullPattern=panel_7)  # -> flatten(List)
cull_5 = CullPattern(List=merge_5, CullPattern=panel_7)  # -> flatten(List)
loop_end = LoopEnd(
    port=loop_start.port,
    Exit=False,
    Data=loop_start.Data,
    Data_2=cull_4,
    Data_3=cull_5,
    Data_4=panel_7,
    TimeOutVal=0,
    pausedState=False,
    state="Constant & Record")  # -> D0, flatten(D1), D2, D3
pt_3 = Point(loop_end.D1)
shift = ShiftList(List=pt_3, Shift=1, Wrap=False)
ln = Line(StartPoint=pt_3, EndPoint=shift)
len = Length(Curve=ln)
python_4 = GhPythonScript(x=len)  # -> out, a; inputs x: list
# ---------- python_4: Python ----------
lst = x


for i in range(len(lst) - 2):
    if lst[i] == 0 and lst[i+1] == 0 and lst[i+2] == 0:
        a = False
    else:
        a = True
# ---------- end python_4 ----------

panel_8 = Panel(python_4.a)
group_2 = Group(Objects=ln)
panel_9 = Panel(loop_start.Counter)

join = JoinCurves(Curves=ln, Preserve=False)

# ==== cluster Cluster
_1層目と地形の距離_number_mm = ClusterInput()
ユニットの高さ_number = ClusterInput()
ボリューム_mesh = ClusterInput()
地形_mesh = ClusterInput()

# ----
# FLをボリュームから取得
mdif = MeshDifference(MeshesA=ボリューム_mesh, MeshesB=地形_mesh)
bbox = BoundingBox(Content=mdif, Plane=PlaneXY(0, 0, 0), UnionBox=True)  # -> Box, Box_2
debox = DeconstructBox(Box=bbox.Box)  # -> Plane, X, Y, Z
dedomain = DeconstructDomain(Domain=debox.Z)  # -> Start, End
addition = Addition(A=_1層目と地形の距離_number_mm, B=dedomain.Start)
subtraction = Subtraction(A=dedomain.End, B=addition)
division = Division(A=subtraction, B=ユニットの高さ_number)
floor = Floor(n=division)  # -> floored; inputs n: list
# ---------- floor: Python ----------
from math import floor

floored = [floor(x) for x in n]
# ---------- end floor ----------
series = Series(Start=addition, Step=ユニットの高さ_number, Count=floor)
Z = UnitZ(Factor=series)
xy = XYPlane(Origin=Z)
sec = MeshPlane(Mesh=mdif, Plane=xy)  # -> simplify(Curves)
srf = Surface(reparameterize(sec))
evalsrf = EvaluateSurface(Surface=srf, Point="0.5,0,5")  # -> Point, Normal, UDirection, VDirection, Frame
devec = DeconstructVector(Vector=evalsrf.Normal)  # -> XComponent, YComponent, ZComponent
larger = LargerThan(FirstNumber=devec.ZComponent, SecondNumber="0")  # -> LargerThan, OrEqualTo
flip = FlipCurve(Curve=sec)  # -> Curve, Flag
weave = Weave(Pattern=larger.OrEqualTo, Stream0=flip.Curve, Stream1=sec, NullGaps=False)
flatten = FlattenTree(Tree=weave, Path="{0}")

fls_curve = ClusterOutput(flatten)

# ==== cluster Cluster_2

Z = UnitZ(Factor=1)
multiplication = Multiplication(A=Z, B="-1")
relay = Relay([multiplication, Z])

relay_2 = ClusterInput()
P = ClusterInput()
meshray = MeshRay(Mesh=relay_2, Point=P, Direction=relay)  # -> Point, Hit
R = ClusterInput()
clean = CleanTree(RemoveNulls=True, RemoveInvalid=True, RemoveEmpty=False, Tree=meshray.Point)
cir = Circle(Plane=clean, Radius=R)
N = ClusterInput()
divide = DivideCurve(Curve=cir, Count=N, Kinks=False)  # -> Points, Tangents, Parameters
meshray_2 = MeshRay(Mesh=relay_2, Point=divide.Points, Direction=graft(relay))  # -> Point, Hit
clean_2 = CleanTree(RemoveNulls=True, RemoveInvalid=True, RemoveEmpty=False, Tree=meshray_2.Point)  # -> flatten(Tree)
vec2pt = Vector2Pt(PointA=clean, PointB=clean_2, Unitize=False)  # -> Vector, Length
Z_2 = UnitZ(Factor=1)
angle = Angle(VectorA=vec2pt.Vector, VectorB=Z_2)  # -> Angle, Reflex
deg = Degrees(Radians=angle.Angle)  # -> flatten(Degrees)
low = ClusterInput()
high = ClusterInput()
subtraction = Subtraction(A="90", B=deg)
python = GhPythonScript(x=subtraction, low=low, high=high)  # -> out, a; inputs x: list
# ---------- python: Python ----------
import math
lst = x
n_lst = []

for n in lst:
    if n >= low and n <= high:
        n_lst.append(n)

max_value = max(n_lst)

a = lst.index(max_value)
# ---------- end python ----------
python_2 = GhPythonScript()  # -> a; inputs x: list
# ---------- python_2: Python ----------
import math
lst = x
n_lst = []
for n in lst:
    if n >= 0 and n <= 25:
        n_lst.append(n)
if len(n_lst)!=0:
    min_value = min(n_lst)

    a = lst.index(min_value)
else:
    if n <= 2:
        n_lst.append(n)
    abs_lst = []
    for n in n_lst:
        abs_lst.append(math.abs(n))
    
    min2_value = sorted(abs_lst)[5]
    
    a = n_lst.index(min2_value)
# ---------- end python_2 ----------
item = ListItem(List=vec2pt.Vector, Index=python.a, Wrap=True)
A = ClusterInput()
amp = Amplitude(Vector=item, Amplitude=A)
vlen = VectorLength(Vector=amp)
move = Move(Geometry=clean, Motion=amp)  # -> Geometry, Transform
G = ClusterOutput(move.Geometry)
