# Grasshopper definition ユニット自動配置[FES2024].gh (Grasshopper 1.0.7)
# plug-ins: eleFront

crv = Curve(<curve referenced from the Rhino model>)
geo = Geometry([<curve referenced from the Rhino model> x20, <brep referenced from the Rhino model> x37])
geo_2 = Geometry([<curve referenced from the Rhino model> x9, <brep referenced from the Rhino model> x46])
geo_3 = Geometry([<curve referenced from the Rhino model> x11, <brep referenced from the Rhino model> x54])
crv_2 = Curve(<curve referenced from the Rhino model>)
geo_4 = Geometry([<curve referenced from the Rhino model> x11, <brep referenced from the Rhino model> x30])

# ----
# ユニット情報
number_slider = Slider(4000, range=0..10000)
crv_3 = Curve(<curve referenced from the Rhino model>)
crv_4 = Curve(<curve referenced from the Rhino model>)
panel = Panel("""25
25
25
25""")
panel_2 = Panel("""Unit[9000×6000]
Unit[12000×6000]
Unit[6000×12000]
Unit[15000×6000]""")
entwine = Entwine(Branch00=geo, Branch01=geo_2, Branch02=geo_4, Branch03=geo_3, FlattenInputs=True)
merge = Merge(Data1=crv_3, Data2=crv_4, Data3=crv_2, Data4=crv)

jagged = SettingsSpeed()
brep = Brep(<brep referenced from the Rhino model>)
mesh = MeshBrep(Brep=brep, Settings=jagged)
tri = Triangulate(Mesh=mesh)  # -> Mesh, Count
mesh_2 = Mesh(tri.Mesh)

mesh_3 = Mesh(<mesh referenced from the Rhino model>)
tri_2 = Triangulate(Mesh=mesh_3)  # -> Mesh, Count

# ----
# FLをボリュームから取得
mdif = MeshDifference(MeshesA=mesh_2, MeshesB=tri_2.Mesh)
bbox = BoundingBox(Content=mdif, Plane=PlaneXY(0, 0, 0), UnionBox=True)  # -> Box, Box_2
debox = DeconstructBox(Box=bbox.Box)  # -> Plane, X, Y, Z
dedomain = DeconstructDomain(Domain=debox.Z)  # -> Start, End
addition = Addition(A=Slider(1682, range=0..10000), B=dedomain.Start)
subtraction = Subtraction(A=dedomain.End, B=addition)
division = Division(A=subtraction, B=number_slider)
floor = Floor(n=division)  # -> floored; inputs n: list; same code as floor
series = Series(Start=addition, Step=number_slider, Count=floor)
Z = UnitZ(Factor=series)
xy = XYPlane(Origin=Z)
sec = MeshPlane(Mesh=mdif, Plane=xy)  # -> simplify(Curves)
srf = Surface(reparameterize(sec))
evalsrf = EvaluateSurface(Surface=srf, Point="0.5,0,5")  # -> Point, Normal, UDirection, VDirection, Frame
devec = DeconstructVector(Vector=evalsrf.Normal)  # -> XComponent, YComponent, ZComponent
larger = LargerThan(FirstNumber=devec.ZComponent, SecondNumber="0")  # -> LargerThan, OrEqualTo
flip = FlipCurve(Curve=sec)  # -> Curve, Flag
weave = Weave(Pattern=larger.OrEqualTo, Stream0=flip.Curve, Stream1=sec, NullGaps=False)
flatten = FlattenTree(Tree=weave, Path="{0}")

# ----
# 住戸プランの情報を取得
bbox_2 = BoundingBox(Content=merge, Plane=PlaneXY(0, 0, 0))  # -> Box, Box_2
debox_2 = DeconstructBox(Box=bbox_2.Box)  # -> Plane, X, Y, Z
rectangle = Rectangle(Plane=PlaneXY(0, 0, 0), XSize=debox_2.X, YSize=debox_2.Y, Radius=0)  # -> Rectangle, Length
domainlength = DomainLength(l=debox_2.X)  # -> d, d_abs; inputs l: list
# ---------- domainlength: Python ----------
d = [ll.T1 - ll.T0 for ll in l]
d_abs = map(abs,d)
# ---------- end domainlength ----------
domainlength_2 = DomainLength(l=debox_2.Y)  # -> d, d_abs; inputs l: list; same code as domainlength
rectanglevertices = Rectangle_vertices(rec=rectangle.Rectangle)  # -> leftlower, rightlower, rightupper, leftupper; inputs rec: list
# ---------- rectanglevertices: Python ----------
def get_rectangle_leftlower(rectangles):
    pl = [r.Plane for r in rectangles]
    xl = list(r.X.T0 for r in rectangles)
    yl = list(r.Y.T0 for r in rectangles)
    xu = list(r.X.T1 for r in rectangles)
    yu = list(r.Y.T1 for r in rectangles)
    xd = tuple(p.XAxis for p in pl)
    yd = tuple(p.YAxis for p in pl)


    t1 = (i*j+k*l for i,j,k,l in zip(xl,xd,yl,yd))
    t2 = (i*j+k*l for i,j,k,l in zip(xu,xd,yl,yd))
    t3 = (i*j+k*l for i,j,k,l in zip(xu,xd,yu,yd))
    t4 = (i*j+k*l for i,j,k,l in zip(xl,xd,yu,yd))

    pl1 = list(map(lambda p:p.Clone(),pl))
    [p.Translate(v) for p,v in zip(pl1,t1)]
    pl2 = list(map(lambda p:p.Clone(),pl))
    [p.Translate(v) for p,v in zip(pl2,t2)]
    pl3 = tuple(map(lambda p:p.Clone(),pl))
    [p.Translate(v) for p,v in zip(pl3,t3)]
    [p.Translate(v) for p,v in zip(pl,t4)]
    pl4 = pl
    return pl1,pl2,pl3,pl4
    
leftlower,rightlower,rightupper,leftupper = get_rectangle_leftlower(rec)
# ---------- end rectanglevertices ----------
xy_2 = XYPlane(Origin=Point(0, 0, 0))
pi = Pi(Factor=1)
rotate = Rotate(Geometry=xy_2, Angle=pi, Plane=PlaneXY(0, 0, 0))  # -> Geometry, Transform
pt = Point(rectanglevertices.leftlower)
move = Move(Geometry=rotate.Geometry, Motion=pt)  # -> Geometry, Transform

# ----
# 住戸の任意ジオメトリをグループ化
group = Group(Objects=entwine)  # -> flatten(Group)

cluster = Cluster()
roomunit_fes2024 = RoomUnitFES2024(w=domainlength.d, d=domainlength_2.d, origin=move.Geometry, name=panel_2, n=panel, geometries=group)  # -> RoomUnit; inputs origin: Plane, n: Int32
# ---------- roomunit_fes2024: Python ----------
from copy import deepcopy
import ghpythonlib.components as ghcomp
class Room:
    def __init__(self,unit_x,unit_y,origin,name,geometries):
        self.w = unit_x
        self.d = unit_y
        self.name = name
        self.origin = origin
        self.placed_plane = None
        self.geometries = geometries
        
    def __str__(self):
        if self.is_placed:
            return "Room:{} [placed]".format(self.name)
        else:
            return "Room:{}".format(self.name)
        
    def place(self,plane):
        
        self.placed_plane = plane
        
        
    def unplace(self):
        self.placed_plane = None
        
        
    @property
    def is_placed(self):
        return bool(self.placed_plane)
        
        
    def copy(self):
        new = Room(self.w,self.d,self.origin.Clone(),self.name,self.geometries)
        if self.is_placed:
            new.place(self.placed_plane)
        return new
        
if w and d and origin and name:
    ru = Room(w,d,origin,name,geometries)
    RoomUnit = [ru.copy() for _ in range(n)]
# ---------- end roomunit_fes2024 ----------

# ----
# 住戸情報をまとめて配置する順番に並び替える
flip_2 = FlipMatrix(Data=roomunit_fes2024)
flatten_2 = FlattenTree(Tree=roomunit_fes2024, Path="{0}")
flatten_3 = FlattenTree(Tree=flip_2, Path="{0}")

srf_2 = Surface(flatten)
jitter = Jitter(List=flatten_3, Jitter=1, Seed=Slider(69, range=0..100))  # -> Values, Indices
panel_3 = Panel(jitter.Values)
preview = CustomPreview(Geometry=srf_2, Material=ColourSwatch(SwatchColor=RGBA(20, 255, 235, 73)))
md_slider = MDSlider(
    SliderMode=0,
    slider_value=Point(0.5090614877, 0.4033649724, 0.5),
    x_domain=Domain(-1, 1),
    y_domain=Domain(-1, 1),
    z_domain=Domain(0, 1))
python = GhPythonScript(x=md_slider)  # -> V; inputs x: Point3d
# ---------- python: Python ----------
from Rhino import Geometry as rg

if x:
    a = rg.Vector3d(x)
    if a.Length==0:
        a = rg.Vector3d.YAxis
    a.Unitize()
    
    V = a
# ---------- end python ----------
crv_5 = Curve(flatten)

# ----
# 配置
arrayroomunit_fes2024 = ArrayRoomUnitFES2024(plan_boundaries=crv_5, direction=python, rooms=jitter.Values, fix_order=Toggle(False))  # -> rooms; inputs plan_boundaries: list of Curve, direction: Vector3d, rooms: list
# ---------- arrayroomunit_fes2024: Python ----------
from Rhino import Geometry as rg
import ghpythonlib.components as ghcomp
from Rhino import RhinoDoc

TOL = RhinoDoc.ActiveDoc.ModelAbsoluteTolerance


if direction: direction.Unitize()
rooms = [r.copy() for r in rooms]

def get_plane_of_curve(curve):
    
    rst,plane = curve.TryGetPlane()
    if not rst:
        raise Exception("Can't get plane")
    else:
        return plane
        
def get_plane_to_array(curve,direction):
    plane_of_boundary = get_plane_of_curve(curve)
    yaxis_to_array = direction
    xaxis_to_array = rg.Vector3d.CrossProduct(yaxis_to_array,rg.Vector3d.ZAxis)
    xaxis_to_array.Unitize()
    plane_to_array = rg.Plane(plane_of_boundary.Origin,xaxis_to_array,yaxis_to_array)
    return plane_to_array
    
def get_bounding_rectangle(curve,plane):
    bb = curve.GetBoundingBox(plane)
    bbrect = rg.Rectangle3d(rg.Plane.WorldXY,bb.Min,bb.Max)
    tr = rg.Transform.ChangeBasis(plane,rg.Plane.WorldXY)
    bbrect.Transform(tr)
    return bbrect
    
def slice_rect_xdir(rect,start_distance,slice_length):
    assert start_distance>=0
    assert slice_length>=0
    lx,ux = rect.X.T0,rect.X.T1
    ly,uy = rect.Y.T0,rect.Y.T1
    stx = lx+start_distance
    enx = stx+slice_length
    if enx>=ux:
        print('over x limit')
        return None
    st_corner = rg.Point3d(rect.Plane.Origin + rect.Plane.XAxis*stx + rect.Plane.YAxis*uy)
    en_corner = rg.Point3d(rect.Plane.Origin + rect.Plane.XAxis*enx + rect.Plane.YAxis*ly)
    sliced_rect = rg.Rectangle3d(rect.Plane,st_corner,en_corner)
    return sliced_rect
    
    
def is_in_rect(pt,rect):
    xa,ya = rect.Plane.XAxis,rect.Plane.YAxis
    pt_local = pt - rect.Plane.Origin
    xlocal,ylocal = xa*pt_local,ya*pt_local
    
    rst = rect.X.IncludesParameter(xlocal) and rect.Y.IncludesParameter(ylocal)
    return rst
    
def is_rect_in_curve(rect,crv):
    rect_as_crv = rect.ToNurbsCurve()
    points = [rect_as_crv.PointAt(t) for t in rect_as_crv.DivideByCount(100,False)]
    points.extend(rect.Corner(i) for i in range(4))
    are_contains = (int(crv.Contains(pt,rect.Plane,TOL)) for pt in points)
    rst = all(are==1 or are==3 for are in are_contains)
    return rst
    
def sorted_curves_by_projected_y_value(curves,plane,from_larger=True):
    middles = [c.PointAtNormalizedLength(0.5) for c in curves]
    ys = [plane.YAxis * rg.Vector3d(p) for p in middles]
    sortedcrvs = [rst[1] for rst in sorted(zip(ys,curves),reverse=from_larger)]
    return sortedcrvs
    

def yaxissplit_rect_by_rects(original_rect,diff_rects):
    def union_if_overlapped(intervals):
        if len(intervals)<2:
            return intervals
        else:
            merged_indices = set()
            new_intervals = []
            for i in range(len(intervals)-1):
                if i in merged_indices: continue
                checking = intervals[i]
                others = intervals[i+1:]
                i_intersected = [j for j,o in enumerate(others) if checking.IncludesInterval(o)]
                if i_intersected:
                    i_intersected = [i+j+1 for j in i_intersected]
                    merged_indices |= set(i_intersected)
                    
                    merged = checking
                    for mi in merged_indices:
                        merged = rg.Interval.FromUnion(merged,intervals[mi])
                    new_intervals.append(merged)
                else:
                    new_intervals.append(checking)
            if len(intervals)-1 not in merged_indices:
                new_intervals.append(intervals[-1])
            return new_intervals
                    
    original_dom = original_rect.Y
    diffs_dom = union_if_overlapped([r.Y for r in diff_rects])
    
    all_values = [original_dom.Min]+[original_dom.Max]+[d.Min for d in diffs_dom]+[d.Max for d in diffs_dom]
    all_values.sort(reverse=True)
    
    y_intervals = [rg.Interval(s,e) for s,e in zip(all_values[:-1],all_values[1:])]
    rects = [rg.Rectangle3d(original_rect.Plane,original_rect.X,y) for y in y_intervals]
    return rects
    
    
def get_rect_in_curve_in_slice(curve,slice_rect):
    rst = rg.Intersect.Intersection.CurveCurve(curve,slice_rect.ToNurbsCurve(),TOL,TOL)
    params_intpt = [r.ParameterA for r in rst if r.IsPoint]
    if len(params_intpt)<2:
        curves = [curve]
    else:
        curves = curve.Split(params_intpt)
    middles = [c.PointAtNormalizedLength(0.5) for c in curves]
    isin = [is_in_rect(p,slice_rect) for p in middles]
    sliced_curves = rg.Curve.JoinCurves([c for c,iir in zip(curves,isin) if iir])
    slcrvs = sorted_curves_by_projected_y_value(sliced_curves,slice_rect.Plane)
    slrects = [get_bounding_rectangle(crv,slice_rect.Plane) for crv in slcrvs]

    splitted_rects = yaxissplit_rect_by_rects(slice_rect,slrects)
    rect_in_curves = [r for r in splitted_rects if is_rect_in_curve(r,curve)]
    if not rect_in_curves: return None
    rect = max(rect_in_curves,key=lambda r: r.Area)
    
    return rect
    
    
def place_room_to_rect(room,rect):
    if room.d<=abs(rect.Y.Length):
        plane = rg.Plane(rect.Corner(1),rect.Plane.XAxis,rect.Plane.YAxis)
        room.place(plane)
        return True
    else:
        return False

def get_room(rooms,except_room_name=[]):
    for r in rooms:
        not_placed = not r.is_placed
        not_except = r.name not in except_room_name
        if not_placed and not_except:
            return r
    else:
        return None

def array_to_curve(boundary,direction,rooms,fix_order):
    if all(r.is_placed for r in rooms): return
    plane_to_array = get_plane_to_array(boundary,direction)
    rect = get_bounding_rectangle(boundary,plane_to_array)
    starting_distance = 0
    placing_room = get_room(rooms)
    init_w = placing_room.w
    
    failured_room_type = []

        
    for _ in range(5000):
        if starting_distance>=abs(rect.X.Length) or placing_room is None: break
        placed = False
        slice_rect = slice_rect_xdir(rect,starting_distance,placing_room.w)
        if slice_rect:
            placing_rect = get_rect_in_curve_in_slice(boundary,slice_rect)
            if placing_rect:
                placed = place_room_to_rect(placing_room,placing_rect)
        
        if placed:
            failured_room_type = []
            starting_distance += placing_room.w
            placing_room = get_room(rooms)
        else:
            if fix_order:
                starting_distance += init_w
            else:
                failured_room_type.append(placing_room.name)
                placing_room = get_room(rooms,except_room_name=failured_room_type)
                if not placing_room: #all rooms type was tried to place
                    failured_room_type = []
                    placing_room = get_room(rooms)
                else:
                    starting_distance += init_w
    else:
        raise TimeOutError
    
    return rooms
    
    
def main():
    for b in plan_boundaries:
        rst = array_to_curve(b,direction,rooms,fix_order)
    else:
        rst = rooms
    return rst
    
    
rooms = main()
# ---------- end arrayroomunit_fes2024 ----------

# ----
# 配置チェック
exploderromunit_fes2024 = ExplodeRoomUnitFES2024(RoomUnit=arrayroomunit_fes2024)  # -> w, d, name, is_placed, geometries, graft(origin), graft(destination)
# ---------- exploderromunit_fes2024: Python ----------
from itertools import chain
w = RoomUnit.w
d = RoomUnit.d
origin = RoomUnit.origin
name = RoomUnit.name
if RoomUnit.is_placed:
    is_placed = True
    destination = RoomUnit.placed_plane
    geometries = RoomUnit.geometries
    #try:
    #    geometries = RoomUnit.geometries['geometry']
    #except:
    #    geometries = RoomUnit.geometries
else:
    is_placed = False
    destination = None
    geometries = None
# ---------- end exploderromunit_fes2024 ----------
orient = Orient(
    Geometry=exploderromunit_fes2024.geometries,
    Source=exploderromunit_fes2024.origin,
    Target=exploderromunit_fes2024.destination)  # -> Geometry, Transform
ma = MassAddition(Input=exploderromunit_fes2024.is_placed)  # -> Result, PartialResults

# ----
# Unitのindexを取得
cull = CullPattern(List=exploderromunit_fes2024.name, CullPattern=exploderromunit_fes2024.is_placed)
indexversatile = IndexVersatile(L=panel_2, v=cull)  # -> i; inputs L: list, v: list
# ---------- indexversatile: Python ----------
def find(ls,value):
    if value in ls:
        i = ls.index(value)
    else:
        i = -1
    return i

if L and v:
    i = [find(L,vv) for vv in v]
# ---------- end indexversatile ----------

# ----
# Rhinoで設定されたUintのMaterialを取得
rhatt = GetRhinoAttributes(Geometry=entwine, fullpath=False)  # -> Name, Layer, Color, MaterialName, SourceFile
tstat = TreeStatistics(Tree=entwine)  # -> Paths, Length, Count
item = ListItem(List=tstat.Paths, Index=indexversatile, Wrap=True)
branch = TreeBranch(Tree=rhatt.MaterialName, Path=item, MaintainPaths=False)

置かれた住戸の数 = Panel(ma.Result)
preview_2 = CustomPreview(Geometry=orient.Geometry, Material=ColourSwatch(SwatchColor=RGB(168, 168, 168)))

branch_2 = TreeBranch(Tree=rhatt.Color, Path=item, MaintainPaths=False)

# ----
# おかれていないBranchを削除
clean = CleanTree(RemoveNulls=True, RemoveInvalid=True, RemoveEmpty=invert(False), Tree=orient.Geometry)

# ----
# Materialを割り当て
ef_att = EleFrontAttributes(ColourSource="Object", ObjectColour=branch_2, MaterialName=branch)  # -> Attributes, Keys, Values, Name, Layer, ColourSource, DisplayColour, MaterialSource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

match = MatchTree(Tree=clean, Guide=ef_att.Attributes)
bake = BakeObjects(Geometry=match, Attributes=ef_att.Attributes, Bake=False, createGroups=True, ValueTable_createGroups=False)  # -> Message, Guids

# ==== cluster Cluster
_1層目と地形の距離_number_mm = ClusterInput()
ユニットの高さ_number = ClusterInput()
ボリューム_mesh = ClusterInput()
地形_mesh = ClusterInput()

# ----
# FLをボリュームから取得
mdif = MeshDifference(MeshesA=ボリューム_mesh, MeshesB=地形_mesh)
bbox = BoundingBox(Content=mdif, Plane=PlaneXY(0, 0, 0), UnionBox=True)  # -> Box, Box_2
debox = DeconstructBox(Box=bbox.Box)  # -> Plane, X, Y, Z
dedomain = DeconstructDomain(Domain=debox.Z)  # -> Start, End
addition = Addition(A=_1層目と地形の距離_number_mm, B=dedomain.Start)
subtraction = Subtraction(A=dedomain.End, B=addition)
division = Division(A=subtraction, B=ユニットの高さ_number)
floor = Floor(n=division)  # -> floored; inputs n: list
# ---------- floor: Python ----------
from math import floor

floored = [floor(x) for x in n]
# ---------- end floor ----------
series = Series(Start=addition, Step=ユニットの高さ_number, Count=floor)
Z = UnitZ(Factor=series)
xy = XYPlane(Origin=Z)
sec = MeshPlane(Mesh=mdif, Plane=xy)  # -> simplify(Curves)
srf = Surface(reparameterize(sec))
evalsrf = EvaluateSurface(Surface=srf, Point="0.5,0,5")  # -> Point, Normal, UDirection, VDirection, Frame
devec = DeconstructVector(Vector=evalsrf.Normal)  # -> XComponent, YComponent, ZComponent
larger = LargerThan(FirstNumber=devec.ZComponent, SecondNumber="0")  # -> LargerThan, OrEqualTo
flip = FlipCurve(Curve=sec)  # -> Curve, Flag
weave = Weave(Pattern=larger.OrEqualTo, Stream0=flip.Curve, Stream1=sec, NullGaps=False)
flatten = FlattenTree(Tree=weave, Path="{0}")

fls_curve = ClusterOutput(flatten)
