# Grasshopper definition 導線分析[FES2024].gh (Grasshopper 1.0.7)
# plug-ins: Bifocals, Anemone

mesh = Mesh(<mesh referenced from the Rhino model>)
brep = Brep(<brep referenced from the Rhino model>)
pt = Point(<point referenced from the Rhino model>)

# ----
# 勾配を色で表示
demesh = DeconstructMesh(Mesh=mesh)  # -> Vertices, Faces, Colours, Normals
Z = UnitZ(Factor=1)
_5_to_10 = ColourSwatch(SwatchColor=RGB(0, 229, 255))
_10_to_15 = ColourSwatch(SwatchColor=RGB(115, 255, 0))
_15_to_20 = ColourSwatch(SwatchColor=RGB(255, 247, 0))
_20_to_25 = ColourSwatch(SwatchColor=RGB(230, 172, 0))
over25 = ColourSwatch(SwatchColor=RGB(199, 0, 0))
_0_to_5 = ColourSwatch(SwatchColor=RGB(0, 76, 255))
angle = Angle(VectorA=demesh.Normals, VectorB=Z)  # -> Angle, Reflex
merge = Merge(Data1=_0_to_5, Data2=_5_to_10, Data3=_10_to_15, Data4=_15_to_20, Data5=_20_to_25, Data6=over25)
deg = Degrees(Radians=angle.Angle)
c_script = CSharpScript(angle=deg, col=merge)  # -> out, A; inputs angle: list of Double, col: list of Color
# ---------- c_script: C# usings ----------
using System.Drawing;
# ---------- c_script: C# ----------
    var colList = new List<Color>();

    foreach(var num in angle){
      if(num > 25){
        colList.Add(col[5]);
      }
      else if(num >= 20){
        colList.Add(col[4]);
      }
      else if(num >= 15){
        colList.Add(col[3]);
      }
      else if(num >= 10){
        colList.Add(col[2]);
      }
      else if(num >= 5){
        colList.Add(col[1]);
      }
      else if(num >= 0){
        colList.Add(col[0]);
      }
    }

    A = colList;
# ---------- end c_script ----------
conmesh = ConstructMesh(Vertices=demesh.Vertices, Faces=demesh.Faces, Colours=c_script.A)

# ----
# Contour
bbox = BoundingBox(Content=mesh, Plane=PlaneXY(0, 0, 0))  # -> Box, Box_2
debox = DeconstructBox(Box=bbox.Box)  # -> Plane, X, Y, Z
range = Range(Domain=debox.Z, Steps=Slider(128, range=10..500))
Z_2 = UnitZ(Factor=range)
xy = XYPlane(Origin=Z_2)
sec = MeshPlane(Mesh=mesh, Plane=xy)

# ----
# 一定勾配以下のfaceのみ表示
facen = FaceNormals(Mesh=mesh)  # -> Centers, Normals
Z_3 = UnitZ(Factor=1)
angle_2 = Angle(VectorA=facen.Normals, VectorB=Z_3)  # -> Angle, Reflex
deg_2 = Degrees(Radians=angle_2.Angle)
smaller = SmallerThan(FirstNumber=Slider(25, range=0..43), SecondNumber=deg_2)  # -> SmallerThan, OrEqualTo
cullf = CullFaces(Mesh=mesh, Pattern=smaller.OrEqualTo)

panel = Panel("""True
False""")

Z_4 = UnitZ(Factor=1)
multiplication = Multiplication(A=Z_4, B="-1")
relay = Relay([multiplication, Z_4])

preview = CustomPreview(Geometry=cullf, Material=ColourSwatch(SwatchColor=RGB(40, 46, 120)))
preview_2 = CustomPreview(Geometry=sec, Material=ColourSwatch(SwatchColor=RGB(0, 0, 0)))
preview_3 = CustomPreview(
    Geometry=conmesh,
    Material={diffuse=RGB(221, 160, 221), emission=RGB(66, 48, 66), shine=0.5, specular=RGB(255, 255, 255), transparency=0})
Z_5 = UnitZ(Factor=1)

探索最小半径 = Slider(1000, range=0..1000)
移動距離 = Slider(1000, range=0..5000)
探索の候補の数 = Slider(24, range=0..64)
number_slider = Slider(15, range=0..30)
number_slider_2 = Slider(0, range=0..10)

series = Series(Start=探索最小半径, Step=Slider(1000, range=0..2000), Count=Slider(5, range=0..100))
cluster = Cluster(relay_2=mesh, P=pt, N=探索の候補の数, A=移動距離, R=series, low=number_slider_2, high=number_slider)
loop_start = LoopStart(N=Slider(208, range=0..1000), T=Button(), D0=mesh, D1=pt, D2=cluster, D3=graft(panel))  # -> port, Counter, Data, Data_2, Data_3, Data_4
subtraction = Subtraction(A=series, B=Slider(0, range=0..1000))
meshray = MeshRay(Mesh=loop_start.Data, Point=loop_start.Data_2, Direction=relay)  # -> Point, Hit
meshray_2 = MeshRay(Mesh=loop_start.Data, Point=loop_start.Data_3, Direction=relay)  # -> Point, Hit
clean = CleanTree(RemoveNulls=True, RemoveInvalid=True, RemoveEmpty=False, Tree=meshray.Point)
clean_2 = CleanTree(RemoveNulls=True, RemoveInvalid=True, RemoveEmpty=False, Tree=meshray_2.Point)  # -> flatten(Tree)
cir = Circle(Plane=clean_2, Radius=series)
divide = DivideCurve(Curve=cir, Count=探索の候補の数, Kinks=False)  # -> Points, Tangents, Parameters
panel_2 = Panel(loop_start.Data_4)
dist = Distance(PointA=clean, PointB=divide.Points)  # -> simplify(Distance)
larger = LargerThan(FirstNumber=dist, SecondNumber=graft(subtraction))  # -> LargerThan, OrEqualTo
flatten = FlattenTree(Tree=divide.Points, Path="{1}")
cull = CullPattern(List=divide.Points, CullPattern=larger.OrEqualTo)  # -> flatten(List)
flatten_2 = FlattenTree(Tree=cull, Path="{0}")
merge_2 = Merge(Data1=flatten, Data2=flatten_2)
cull_2 = CullPattern(List=merge_2, CullPattern=panel_2)  # -> flatten(List)
meshray_3 = MeshRay(Mesh=loop_start.Data, Point=cull_2, Direction=relay)  # -> Point, Hit
clean_3 = CleanTree(RemoveNulls=True, RemoveInvalid=True, RemoveEmpty=False, Tree=meshray_3.Point)  # -> flatten(Tree)
vec2pt = Vector2Pt(PointA=clean_2, PointB=clean_3, Unitize=False)  # -> Vector, Length
angle_3 = Angle(VectorA=vec2pt.Vector, VectorB=Z_5)  # -> Angle, Reflex
deg_3 = Degrees(Radians=angle_3.Angle)  # -> flatten(Degrees)
subtraction_2 = Subtraction(A="90", B=deg_3)
python = GhPythonScript(x=subtraction_2, low=number_slider_2, high=number_slider)  # -> a, simplify(graft(b)); inputs x: list
# ---------- python: Python ----------
import math
lst = x
n_lst = []
b = [True,False]

for n in lst:
    if n >= low and n <= high:
        n_lst.append(n)
if len(n_lst) == 0:
    b = [False,True]
else:
    max_value = max(n_lst)
    a = lst.index(max_value)
# ---------- end python ----------
item = ListItem(List=vec2pt.Vector, Index=python.a, Wrap=True)
amp = Amplitude(Vector=item, Amplitude=移動距離)
merge_3 = Merge(Data1=loop_start.Data_3, Data2=loop_start.Data_2)  # -> simplify(graft(Result))
move = Move(Geometry=clean_2, Motion=amp)  # -> Geometry, Transform
panel_3 = Panel(python.b)
merge_4 = Merge(Data1=move.Geometry, Data2=loop_start.Data_3)  # -> simplify(graft(Result))
cull_3 = CullPattern(List=merge_3, CullPattern=panel_3)  # -> flatten(List)
cull_4 = CullPattern(List=merge_4, CullPattern=panel_3)  # -> flatten(List)
loop_end = LoopEnd(
    port=loop_start.port,
    Exit=False,
    Data=loop_start.Data,
    Data_2=cull_3,
    Data_3=cull_4,
    Data_4=panel_3,
    TimeOutVal=0,
    pausedState=False,
    state="Constant & Record")  # -> D0, flatten(D1), D2, D3
pt_2 = Point(loop_end.D1)
shift = ShiftList(List=pt_2, Shift=1, Wrap=False)
ln = Line(StartPoint=pt_2, EndPoint=shift)
len = Length(Curve=ln)
python_2 = GhPythonScript(x=len)  # -> out, a; inputs x: list
# ---------- python_2: Python ----------
lst = x


for i in range(len(lst) - 2):
    if lst[i] == 0 and lst[i+1] == 0 and lst[i+2] == 0:
        a = False
    else:
        a = True
# ---------- end python_2 ----------

panel_4 = Panel(python_2.a)
group = Group(Objects=ln)
panel_5 = Panel(loop_start.Counter)

# ==== cluster Cluster

Z = UnitZ(Factor=1)
multiplication = Multiplication(A=Z, B="-1")
relay = Relay([multiplication, Z])

relay_2 = ClusterInput()
P = ClusterInput()
meshray = MeshRay(Mesh=relay_2, Point=P, Direction=relay)  # -> Point, Hit
R = ClusterInput()
clean = CleanTree(RemoveNulls=True, RemoveInvalid=True, RemoveEmpty=False, Tree=meshray.Point)
cir = Circle(Plane=clean, Radius=R)
N = ClusterInput()
divide = DivideCurve(Curve=cir, Count=N, Kinks=False)  # -> Points, Tangents, Parameters
meshray_2 = MeshRay(Mesh=relay_2, Point=divide.Points, Direction=graft(relay))  # -> Point, Hit
clean_2 = CleanTree(RemoveNulls=True, RemoveInvalid=True, RemoveEmpty=False, Tree=meshray_2.Point)  # -> flatten(Tree)
vec2pt = Vector2Pt(PointA=clean, PointB=clean_2, Unitize=False)  # -> Vector, Length
Z_2 = UnitZ(Factor=1)
angle = Angle(VectorA=vec2pt.Vector, VectorB=Z_2)  # -> Angle, Reflex
deg = Degrees(Radians=angle.Angle)  # -> flatten(Degrees)
low = ClusterInput()
high = ClusterInput()
subtraction = Subtraction(A="90", B=deg)
python = GhPythonScript(x=subtraction, low=low, high=high)  # -> out, a; inputs x: list
# ---------- python: Python ----------
import math
lst = x
n_lst = []

for n in lst:
    if n >= low and n <= high:
        n_lst.append(n)

max_value = max(n_lst)

a = lst.index(max_value)
# ---------- end python ----------
python_2 = GhPythonScript()  # -> a; inputs x: list
# ---------- python_2: Python ----------
import math
lst = x
n_lst = []
for n in lst:
    if n >= 0 and n <= 25:
        n_lst.append(n)
if len(n_lst)!=0:
    min_value = min(n_lst)

    a = lst.index(min_value)
else:
    if n <= 2:
        n_lst.append(n)
    abs_lst = []
    for n in n_lst:
        abs_lst.append(math.abs(n))
    
    min2_value = sorted(abs_lst)[5]
    
    a = n_lst.index(min2_value)
# ---------- end python_2 ----------
item = ListItem(List=vec2pt.Vector, Index=python.a, Wrap=True)
A = ClusterInput()
amp = Amplitude(Vector=item, Amplitude=A)
vlen = VectorLength(Vector=amp)
move = Move(Geometry=clean, Motion=amp)  # -> Geometry, Transform
G = ClusterOutput(move.Geometry)
