# Grasshopper definition 日射解析[FES2024].gh (Grasshopper 1.0.7)

# ----
# 太陽光取得
panel = Panel("""3
6
9
12""")
series = Series(Start="0", Step=1, Count="23")
constrloc = LBConstructLocation(name="FES2024 Hill", latitude="35.66", longitude="139.75", time_zone="9", elevation=0)  # -> location; plug-in component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
crossref = CrossReference(ListA=panel, ListB=series, CrossMode=1)  # -> ListA, ListB
hoy = LBCalculateHOY(month=crossref.ListA, day="15", hour=crossref.ListB)  # -> flatten(hoy), flatten(doy), flatten(date); plug-in component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
Y = UnitY(Factor=1)
sunpath = LBSunPath(north=Y, location=constrloc, hoys=hoy.hoy, scale=1)  # -> report, vectors, altitudes, azimuths, hoys, sun_pts, analemma, daily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; plug-in component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
vec = Vector(sunpath.vectors)

mesh = Mesh(<mesh referenced from the Rhino model>)

# ----
# 日射量解析
rev = Reverse(Vector=vec)
facen = FaceNormals(Mesh=mesh)  # -> Centers, Normals
amp = Amplitude(Vector=rev, Amplitude="1000000")
graft = GraftTree(Tree=amp, IncludeEmptyLists=True, IncludeNullItems=True)
graft_2 = GraftTree(Tree=vec, IncludeEmptyLists=True, IncludeNullItems=True)
addition = Addition(A=facen.Centers, B=graft)
meshray = MeshRay(Mesh=mesh, Point=addition, Direction=graft_2)  # -> Point, Hit
lng = ListLength(List=facen.Centers)
meshcp = MeshClosestPoint(Point=meshray.Point, Mesh=mesh)  # -> Point, Index, Parameter
series_2 = Series(Start=0, Step=1, Count=lng)
flatten = FlattenTree(Tree=meshcp.Index, Path="{0}")
int = Integer(flatten)
python = GhPythonScript(face_index=series_2, hitted_indices=int)  # -> count; inputs face_index: list, hitted_indices: list
# ---------- python: Python ----------
from collections import Counter


counter = Counter(hitted_indices)
count = [0 for _ in range(len(face_index))]

for key,value in counter.items():
    if key is not None:
        count[key] = value
# ---------- end python ----------
demesh = DeconstructMesh(Mesh=mesh)  # -> Vertices, Faces, Colours, Normals
max = Max(num=python)  # -> i_max, max; inputs num: list
# ---------- max: Python ----------
if num:
    i_max = max(enumerate(num),key=lambda en: en[1])[0]
    max_ = num[i_max]
# ---------- end max ----------
deface = DeconstructFace(Face=demesh.Faces)  # -> CornerA, CornerB, CornerC, CornerD
gradient = Gradient(LowerLimit=0, UpperLimit=max.max, Parameter=python, stops=[0: RGB(128, 255, 255), 1: RGB(220, 0, 40)])
entwine = Entwine(Branch00=deface.CornerA, Branch01=deface.CornerB, Branch02=deface.CornerC, Branch03=deface.CornerD, FlattenInputs=True)
flip = FlipMatrix(Data=entwine)
item = ListItem(List=demesh.Vertices, Index=flip, Wrap=True)
match = MatchTree(Tree=graft(gradient), Guide=item)
face = MeshFace("Q{0;1;2;3}")
conmesh = ConstructMesh(Vertices=item, Faces=face, Colours=match)  # -> flatten(Mesh)
mjoin = MeshJoin(Meshes=conmesh)

preview = CustomPreview(
    Geometry=mjoin,
    Material={diffuse=RGB(221, 160, 221), emission=RGB(66, 48, 66), shine=0.5, specular=RGB(255, 255, 255), transparency=0})
