# Grasshopper definition 階段.gh (Grasshopper 1.0.7)

curve = Curve(<curve referenced from the Rhino model>)
divide_curve = DivideCurve(Curve=curve, Count=Slider(100, range=0..100), Kinks=False)  # -> Points, Tangents, Parameters
number_slider = Slider(1000, range=0..1000)
evaluate_curve = EvaluateCurve(Curve=curve, Parameter=divide_curve.Parameters)  # -> Point, Tangent, Angle
deconstruct_vector = DeconstructVector(Vector=evaluate_curve.Tangent)  # -> XComponent, YComponent, ZComponent
center_box = CenterBox(Base=divide_curve.Points, X=number_slider, Y=number_slider, Z=Slider(300, range=0..1000))
point = Point(divide_curve.Points)
vector_xyz = VectorXYZ(XComponent=deconstruct_vector.XComponent, YComponent=deconstruct_vector.YComponent, ZComponent="0")  # -> Vector, Length
xy_plane = XYPlane(Origin=point)
construct_plane = ConstructPlane(Origin=point, XAxis=vector_xyz.Vector, YAxis=Vector(0, 1, 0))

# ---- group: 回転させた
orient = Orient(Geometry=center_box, Source=xy_plane, Target=construct_plane)  # -> Geometry, Transform

# ---- group: ラインに並べた
geometry = Geometry(center_box)
